# Dynamo graph spirograph.dyn (Dynamo 0.8.0.950)

outer_ring_radius = DoubleSlider(57.98, range=1..500 step 0.01)
gear_radius = DoubleSlider(72.13, range=1..500 step 0.01)
pen_offset = DoubleSlider(108.92, range=0..250 step 0.01)
step_size = DoubleSlider(0.046, range=0.001..0.2 step 0.001)
epicycloid = BoolSelector(true)
python_script = Python(IN[0]=outer_ring_radius, IN[1]=gear_radius, IN[2]=pen_offset, IN[3]=step_size, IN[4]=epicycloid)
# ---------- python_script.python (63 lines) ----------
import clr
clr.AddReference('ProtoGeometry')
from Autodesk.DesignScript.Geometry import *

import sys
sys.path.append(r'C:\Program Files (x86)\IronPython 2.7\Lib')

#The inputs to this node will be stored as a list in the IN variable.
dataEnteringNode = IN

import math
import random

PI = 3.14159
out_points = []
R = float(IN[0])
r = float(IN[1])
p = float(IN[2])
step = float(IN[3])
epicycloid = bool(IN[4])


def jitter():
	r = random.random() - 0.5
	return r * 0.00002

def seq(start, stop, step=1):
    n = int(round((stop - start)/step))
    if n > 1:
        return([start + step*i for i in range(n+1)])
    else:
        return([])

def hypocycloidPoint(R, r, p, t):
	a = R - r
	b = r/R * t
	c = (1 - r/R) * t
	x = a * math.cos(b) - p * math.cos(c)
	y = a * math.sin(b) + p * math.sin(c)
	return Point.ByCoordinates(x, y)
	
	
def epicycloidPoint(R, r, p, t):
	a = R + r
	b = r/R * t
	c = (1 + r/R) * t
	x = a * math.cos(b) - p * math.cos(c)
	y = a * math.sin(b) + p * math.sin(c)
	return Point.ByCoordinates(x, y)

def hypocycloidLine(R, r, p, t1, t2):
	return Line.ByStartPointEndPoint(hypocycloidPoint(R, r, p, t1), hypocycloidPoint(R, r, p, t2))


def epicycloidLine(R, r, p, t1, t2):
	return Line.ByStartPointEndPoint(epicycloidPoint(R, r, p, t1), epicycloidPoint(R, r, p, t2))

for t in seq(0 * PI, 36 * PI, step):
	#out_points.Add(epicycloidPoint(R, r, p, t) if epicycloid else hypocycloidPoint(R, r, p, t))
	out_points.Add(epicycloidLine(R, r, p, t, t + step) if epicycloid else hypocycloidLine(R, r, p, t, t + step))
	
#Assign your output to the OUT variable
OUT = out_points
# ----------------------------------------
python_script_2 = Python(IN[0]=python_script)
# ---------- python_script_2.python (34 lines) ----------
import clr
clr.AddReference('ProtoGeometry')
from Autodesk.DesignScript.Geometry import *

import sys
sys.path.append(r'C:\Program Files (x86)\IronPython 2.7\Lib')

#The inputs to this node will be stored as a list in the IN variable.
dataEnteringNode = IN

import math
import random

PI = 3.14159
out_polygons = []
lines = IN[0]

for line in lines:
	d1 = math.sqrt(math.pow(line.StartPoint.X, 2) + math.pow(line.StartPoint.Y, 2)) * 0.05
	d2 = math.sqrt(math.pow(line.EndPoint.X, 2) + math.pow(line.EndPoint.Y, 2)) * 0.05
	n = Vector.ByTwoPoints(line.StartPoint, line.EndPoint)
	v1 = n.Cross(Vector.ByCoordinates(0, 0, 1)).Normalized().Scale(d1)
	v2 = n.Cross(Vector.ByCoordinates(0, 0, 1)).Normalized().Scale(d2)

	pts = []
	pts.Add(line.StartPoint.Add(v1))
	pts.Add(line.StartPoint.Subtract(v1))
	pts.Add(line.EndPoint.Subtract(v2))
	pts.Add(line.EndPoint.Add(v2))
	out_polygons.Add(Polygon.ByPoints(pts))

	
#Assign your output to the OUT variable
OUT = out_polygons
# ----------------------------------------
